# Dynamo graph CARGAR PARAMETRO COMPARTIDO INTEGRACIÓN.dyn (Dynamo 3.3.0.6316)

python_script = Python()  # CPython3; unwired: IN[0]
# ---------- python_script.python (77 lines) ----------
import clr

# 1. Cargar API de Revit
clr.AddReference('RevitAPI')
from Autodesk.Revit.DB import *

# 2. Cargar Servicios de Dynamo
clr.AddReference('RevitServices')
import RevitServices
from RevitServices.Persistence import DocumentManager
from RevitServices.Transactions import TransactionManager

doc = DocumentManager.Instance.CurrentDBDocument
app = doc.Application

# --- CONFIGURACIÓN ---
ruta_txt = r"C:\Users\DELL\Documents\CDE NORA\PARAMETROS COMPARTIDOS.txt"

nombres_parametros = [
    "MATERIAL INTEGRADO", "NIVEL INTEGRADO", "CLASIFICACIÓN", 
    "AREA INTEGRADO", "LONGITUD INTEGRADO", "NOMBRE INTEGRADO", "VOLUMEN INTEGRADO"
]

# 3. Cargar Archivo de Parámetros Compartidos
app.SharedParametersFilename = ruta_txt
def_file = app.OpenSharedParameterFile()

if def_file is None:
    OUT = "Error: No se pudo abrir el archivo TXT en la ruta especificada."
else:
    # 4. Crear el CategorySet con categorías principales de modelo
    cat_set = app.Create.NewCategorySet()
    
    for cat in doc.Settings.Categories:
        # Solo categorías principales de modelo o anotación que permitan vinculación
        if cat.AllowsBoundParameters and cat.CategoryType == CategoryType.Model:
            cat_set.Insert(cat)

    # 5. Ejecutar transacción
    TransactionManager.Instance.EnsureInTransaction(doc)
    resultados = []

    try:
        # Compatibilidad de grupo entre versiones de Revit (Revit 2024+ usa GroupTypeId)
        try:
            grupo_final = GroupTypeId.IdentityData
        except AttributeError:
            grupo_final = BuiltInParameterGroup.PG_IDENTITY_DATA

        binding_map = doc.ParameterBindings

        for nombre in nombres_parametros:
            p_def = None
            for group in def_file.Groups:
                p_def = group.Definitions.get_Item(nombre)
                if p_def is not None:
                    break
            
            if p_def is not None:
                nuevo_binding = app.Create.NewInstanceBinding(cat_set)
                
                # Si el parámetro ya existe en el proyecto, se actualiza con ReInsert
                if binding_map.Contains(p_def):
                    binding_map.ReInsert(p_def, nuevo_binding, grupo_final)
                    resultados.append(f"Actualizado (ReInsert): {nombre}")
                else:
                    binding_map.Insert(p_def, nuevo_binding, grupo_final)
                    resultados.append(f"Insertado nuevo: {nombre}")
            else:
                resultados.append(f"No hallado en TXT: {nombre}")

        OUT = "\n".join(resultados)

    except Exception as e:
        OUT = f"Error crítico: {str(e)}"

    TransactionManager.Instance.TransactionTaskDone()
# ----------------------------------------
watch = Watch(python_script)
