# Dynamo graph CREAR IFC.dyn (Dynamo 2.19.3.6394)

python_script = Python()  # CPython3; unwired: IN[0]
# ---------- python_script.python (88 lines) ----------
import clr
import os

# Cargar librerías de interfaz de Windows
clr.AddReference('System.Windows.Forms')
from System.Windows.Forms import FolderBrowserDialog, DialogResult, MessageBox

# Cargar API de Revit
clr.AddReference('RevitAPI')
from Autodesk.Revit.DB import *

clr.AddReference('RevitServices')
import RevitServices
from RevitServices.Persistence import DocumentManager
from RevitServices.Transactions import TransactionManager

doc = DocumentManager.Instance.CurrentDBDocument

# --- 1. VALIDACIÓN DE VISTA ACTIVA ---
active_view = doc.ActiveView
if active_view.ViewType != ViewType.ThreeD:
    MessageBox.Show(
        "Debes estar en una vista 3D activa para exportar el IFC con esta configuración.",
        "Vista Inválida"
    )
    OUT = 0
else:
    # --- 2. VENTANA DE SELECCIÓN (Sin memoria previa) ---
    dialog = FolderBrowserDialog()
    dialog.Description = "Seleccione la carpeta para exportar el IFC"

    clr.AddReference('System')
    import System
    dialog.RootFolder = System.Environment.SpecialFolder.Desktop

    if dialog.ShowDialog() == DialogResult.OK:
        folder_path = dialog.SelectedPath
        
        # Limpieza de nombre
        raw_name = doc.Title.split(".rvt")[0].split("_backup")[0]
        file_name = "".join(c for c in raw_name if c not in r'\/:*?"<>|')

        # --- 3. CONFIGURACIÓN IFC (Nombres limpios para reemplazo de tipos) ---
        options = IFCExportOptions()
        options.FileVersion = IFCVersion.IFC2x3CV2
        
        # Opciones generales (según la configuración inicial)
        options.AddOption("ExportInternalRevitPropertySets", "True")
        options.AddOption("ExportPartsAsElements", "True")
        options.AddOption("LocationContext", "Shared")
        options.AddOption("ExportVisibleElementsInView", "True")
        
        # CONFIGURACIÓN EXACTA DE NOMENCLATURA:
        # 1. Solo el nombre del tipo (ej: "2") para el tipo IFC
        options.AddOption("UseTypeNameOnlyForIfcType", "True")
        
        # 2. Desactivar prefijos de familia y categoría
        options.AddOption("UseFamilyAndTypeNameForReference", "False")
        options.AddOption("UseVisibleRevitNameAsEntityName", "False")
        
        options.FilterViewId = active_view.Id
        options.SpaceBoundaryLevel = 0 

        # --- 4. EXPORTACIÓN ---
        TransactionManager.Instance.EnsureInTransaction(doc)
        try:
            success = doc.Export(folder_path, file_name, options)
            TransactionManager.Instance.TransactionTaskDone()
            
            if success:
                expected_file = os.path.join(folder_path, file_name + ".ifc")
                if os.path.exists(expected_file):
                    os.startfile(folder_path)
                    MessageBox.Show(f"IFC Creado con éxito:\n{file_name}.ifc", "BIM Automation")
                    OUT = 1
                else:
                    MessageBox.Show("El proceso terminó pero no se encontró el archivo.", "Advertencia")
                    OUT = 0
            else:
                MessageBox.Show("Revit devolvió False al intentar exportar.", "Fallo de Exportación")
                OUT = 0
                
        except Exception as e:
            TransactionManager.Instance.TransactionTaskDone()
            MessageBox.Show(f"Error durante la exportación:\n{str(e)}", "Error")
            OUT = -1
    else:
        OUT = 2
# ----------------------------------------
watch = Watch(python_script)
