# Dynamo graph INTEGRACIÓN.dyn (Dynamo 3.3.0.6316)

nivel_integrado = Python()  # CPython3; unwired: IN[0]
# ---------- nivel_integrado.python (66 lines) ----------
import clr

# Importar Revit API
clr.AddReference('RevitAPI')
from Autodesk.Revit.DB import *

# Importar DocumentManager y TransactionManager
clr.AddReference('RevitServices')
import RevitServices
from RevitServices.Persistence import DocumentManager
from RevitServices.Transactions import TransactionManager

doc = DocumentManager.Instance.CurrentDBDocument

# 1. Obtener todos los elementos del modelo que no sean tipos
col = FilteredElementCollector(doc).WhereElementIsNotElementType().ToElements()

# 2. Lista de parámetros en orden de prioridad
nombres_busqueda = ["Nivel de referencia", "Nivel", "Nivel base", "Restricción de base"]
parametro_destino = "NIVEL INTEGRADO"

TransactionManager.Instance.EnsureInTransaction(doc)

conteo_exitos = 0

for el in col:
    # Solo procesar elementos que tengan el parámetro destino
    p_dest = el.LookupParameter(parametro_destino)
    
    # En CPython3, a veces es mejor verificar p_dest is not None
    if p_dest is not None and not p_dest.IsReadOnly:
        valor_encontrado = None
        
        # 3. Buscar el primer parámetro que coincida y tenga valor
        for nombre in nombres_busqueda:
            p_origen = el.LookupParameter(nombre)
            
            if p_origen is not None and p_origen.HasValue:
                # Intentamos obtener el valor como texto (Nombre del nivel)
                valor_encontrado = p_origen.AsValueString()
                
                # Si AsValueString falla o es nulo, intentamos por ElementId
                if not valor_encontrado:
                    id_nivel = p_origen.AsElementId()
                    
                    # Validación de ID compatible con Revit 2024+ y versiones previas
                    if id_nivel and id_nivel != ElementId.InvalidElementId:
                        nivel_obj = doc.GetElement(id_nivel)
                        if nivel_obj:
                            valor_encontrado = nivel_obj.Name
                
                if valor_encontrado:
                    break
        
        # 4. Escribir el valor en NIVEL INTEGRADO
        if valor_encontrado:
            try:
                p_dest.Set(valor_encontrado)
                conteo_exitos += 1
            except:
                continue

TransactionManager.Instance.TransactionTaskDone()

# Salida con el conteo de elementos afectados (usando f-strings de Python 3)
OUT = f"Proceso completado. Se actualizaron {conteo_exitos} elementos."
# ----------------------------------------
watch = Watch(nivel_integrado)
material_integrado = Python()  # CPython3; unwired: IN[0]
# ---------- material_integrado.python (81 lines) ----------
import clr

# Importar Revit API
clr.AddReference('RevitAPI')
from Autodesk.Revit.DB import *

# Importar DocumentManager y TransactionManager
clr.AddReference('RevitServices')
import RevitServices
from RevitServices.Persistence import DocumentManager
from RevitServices.Transactions import TransactionManager

doc = DocumentManager.Instance.CurrentDBDocument

# Recolectar TODOS los elementos que no sean tipos
collector = FilteredElementCollector(doc).WhereElementIsNotElementType().ToElements()

resultados = []

TransactionManager.Instance.EnsureInTransaction(doc)

for e in collector:
    try:
        # Validación de categoría para CPython3
        if e.Category is None: 
            continue
        
        nombre_mat = None
        type_id = e.GetTypeId()
        
        # Validación de ElementId compatible
        e_type = doc.GetElement(type_id) if type_id != ElementId.InvalidElementId else None
        
        # ESTRATEGIA 1: Estructuras compuestas (Muros, Suelos, Techos)
        if e_type is not None and hasattr(e_type, "GetCompoundStructure"):
            comp_struc = e_type.GetCompoundStructure()
            if comp_struc is not None:
                layers = comp_struc.GetLayers()
                if layers:
                    m_id = layers[0].MaterialId
                    if m_id != ElementId.InvalidElementId:
                        material_elem = doc.GetElement(m_id)
                        if material_elem:
                            nombre_mat = material_elem.Name

        # ESTRATEGIA 2: Parámetros de Material en Instancia
        if not nombre_mat:
            for p_name in ["Material", "Structural Material", "Material estructural"]:
                p = e.LookupParameter(p_name)
                if p is not None and p.HasValue:
                    m_id = p.AsElementId()
                    if m_id != ElementId.InvalidElementId:
                        material_elem = doc.GetElement(m_id)
                        if material_elem:
                            nombre_mat = material_elem.Name
                            break

        # ESTRATEGIA 3: Buscar en el Tipo
        if not nombre_mat and e_type is not None:
            p = e_type.LookupParameter("Material")
            if p is not None and p.HasValue:
                m_id = p.AsElementId()
                if m_id != ElementId.InvalidElementId:
                    material_elem = doc.GetElement(m_id)
                    if material_elem:
                        nombre_mat = material_elem.Name

        # ESCRIBIR RESULTADO
        if nombre_mat:
            param_destino = e.LookupParameter("MATERIAL INTEGRADO")
            if param_destino is not None and not param_destino.IsReadOnly:
                param_destino.Set(nombre_mat)
                resultados.append(f"{e.Category.Name}: {nombre_mat}")
                
    except Exception:
        continue

TransactionManager.Instance.TransactionTaskDone()

# Salida formateada para Python 3
OUT = f"Se procesaron {len(resultados)} materiales con éxito." if resultados else "No se encontraron materiales para asignar."
# ----------------------------------------
watch_2 = Watch(material_integrado)
dimensiones_integradas = Python()  # CPython3; unwired: IN[0]
# ---------- dimensiones_integradas.python (314 lines) ----------
import clr
import math

# 1. Cargar API de Revit
clr.AddReference('RevitAPI')
from Autodesk.Revit.DB import *

# 2. Cargar Servicios de Dynamo
clr.AddReference('RevitServices')
import RevitServices
from RevitServices.Persistence import DocumentManager
from RevitServices.Transactions import TransactionManager

doc = DocumentManager.Instance.CurrentDBDocument

opt = Options()
opt.DetailLevel = ViewDetailLevel.Fine
opt.ComputeReferences = True
opt.IncludeNonVisibleObjects = True

# ============================================================
# FUNCIONES AUXILIARES BLINDADAS
# ============================================================

def es_solido_valido(s):
    """Valida si un sólido de Revit es cerrado, tiene caras y volumen positivo."""
    if s is None:
        return False
    try:
        if s.Faces.IsEmpty:
            return False
        return s.Volume > 0.00001
    except Exception:
        return False

def obtener_solidos(element):
    """Extrae todos los sólidos geométricos reales protegiendo contra excepciones."""
    solidos = []
    try:
        geom = element.get_Geometry(opt)
        if geom is None:
            return solidos
        
        for obj in geom:
            if isinstance(obj, Solid):
                if es_solido_valido(obj):
                    solidos.append(obj)
            elif isinstance(obj, GeometryInstance):
                inst_geom = obj.GetInstanceGeometry()
                if inst_geom:
                    for s in inst_geom:
                        if isinstance(s, Solid) and es_solido_valido(s):
                            solidos.append(s)
    except Exception:
        pass
    return solidos

# ============================================================
# PROCESAMIENTO POR CATEGORÍA
# ============================================================

def procesar_muro(wall, solidos):
    """Calcula volumen, área útil y longitud de muros rectos o curvos."""
    # Descartar muros cortina
    try:
        wall_type = doc.GetElement(wall.GetTypeId())
        if hasattr(wall_type, "Kind") and wall_type.Kind == WallKind.Curtain:
            return None, None, None
    except Exception:
        pass

    # 1. Volumen nativo
    p_vol = wall.get_Parameter(BuiltInParameter.HOST_VOLUME_COMPUTED)
    vol = p_vol.AsDouble() if (p_vol and p_vol.HasValue and p_vol.AsDouble() > 0.0001) else sum(s.Volume for s in solidos)

    # 2. Longitud nativa / eje
    longitud = None
    if isinstance(wall.Location, LocationCurve):
        longitud = wall.Location.Curve.Length

    # 3. Área nativa
    area_util = None
    p_area = wall.get_Parameter(BuiltInParameter.HOST_AREA_COMPUTED)
    if p_area and p_area.HasValue and p_area.AsDouble() > 0.0001:
        area_util = p_area.AsDouble()
    else:
        caras_laterales = []
        for s in solidos:
            for face in s.Faces:
                bb = face.GetBoundingBox()
                u_mid = (bb.Min.U + bb.Max.U) / 2.0
                v_mid = (bb.Min.V + bb.Max.V) / 2.0
                try:
                    normal = face.ComputeNormal(UV(u_mid, v_mid))
                    if abs(normal.Z) < 0.2:
                        caras_laterales.append(face.Area)
                except Exception:
                    continue

        if caras_laterales:
            caras_laterales.sort(reverse=True)
            area_util = caras_laterales[0]

    return vol, area_util, longitud

def procesar_viga_exacta(viga, solidos):
    """Calcula volumen y longitud física real de vigas."""
    if not solidos:
        return 0.0, None, 0.0

    vol_total = sum(s.Volume for s in solidos)
    
    if len(solidos) > 1:
        longitud_total = 0.0
        for s in solidos:
            aristas_m = sorted([e.AsCurve().Length for e in s.Edges], reverse=True)
            if aristas_m:
                longitud_total += aristas_m[0]
        return vol_total, None, longitud_total

    s = solidos[0]
    aristas = [e.AsCurve() for e in s.Edges if e.AsCurve().Length > 0.01]
    if not aristas:
        return vol_total, None, 0.0

    aristas_ordenadas = sorted(aristas, key=lambda c: c.Length, reverse=True)
    longitudes = [c.Length for c in aristas_ordenadas]

    longitud_elegida = longitudes[0]
    if len(longitudes) >= 3:
        if abs(longitudes[1] - longitudes[2]) < 0.005 and abs(longitudes[0] - longitudes[1]) > 0.005:
            longitud_elegida = longitudes[1]

    return vol_total, None, longitud_elegida

def procesar_columna(col, solidos):
    """Calcula volumen y altura vertical neta de columnas."""
    p_vol = col.get_Parameter(BuiltInParameter.HOST_VOLUME_COMPUTED)
    vol = p_vol.AsDouble() if (p_vol and p_vol.HasValue and p_vol.AsDouble() > 0.00001) else sum(s.Volume for s in solidos)

    altura = None
    for bip in (BuiltInParameter.INSTANCE_LENGTH_PARAM, BuiltInParameter.STRUCTURAL_FRAME_CUT_LENGTH):
        p = col.get_Parameter(bip)
        if p and p.HasValue and p.AsDouble() > 0.0001:
            altura = p.AsDouble()
            break

    if altura is None and solidos:
        bb = col.get_BoundingBox(None)
        if bb:
            altura = abs(bb.Max.Z - bb.Min.Z)

    return vol, None, altura

def procesar_tuberia(pipe, solidos):
    """Calcula longitud de tuberías."""
    longitud = None
    if isinstance(pipe.Location, LocationCurve):
        longitud = pipe.Location.Curve.Length
    else:
        p_len = pipe.get_Parameter(BuiltInParameter.CURVE_ELEM_LENGTH)
        if p_len and p_len.HasValue:
            longitud = p_len.AsDouble()

    area_ext = None
    p_area = pipe.get_Parameter(BuiltInParameter.RBS_CURVE_SURFACE_AREA)
    if p_area and p_area.HasValue and p_area.AsDouble() > 0.0001:
        area_ext = p_area.AsDouble()

    return None, area_ext, longitud

def procesar_ducto(duct, solidos):
    """Calcula longitud y área de conductos."""
    longitud = None
    if isinstance(duct.Location, LocationCurve):
        longitud = duct.Location.Curve.Length
    else:
        p_len = duct.get_Parameter(BuiltInParameter.CURVE_ELEM_LENGTH)
        if p_len and p_len.HasValue:
            longitud = p_len.AsDouble()

    area_ext = None
    p_area = duct.get_Parameter(BuiltInParameter.RBS_CURVE_SURFACE_AREA)
    if p_area and p_area.HasValue and p_area.AsDouble() > 0.0001:
        area_ext = p_area.AsDouble()

    return None, area_ext, longitud

def procesar_part(part, solidos):
    """Calcula volumen y área útil para piezas (Parts)."""
    vol = sum(s.Volume for s in solidos)
    area_util = None
    caras_verticales = []
    for s in solidos:
        for face in s.Faces:
            bb = face.GetBoundingBox()
            u_mid = (bb.Min.U + bb.Max.U) / 2.0
            v_mid = (bb.Min.V + bb.Max.V) / 2.0
            try:
                norm = face.ComputeNormal(UV(u_mid, v_mid))
                if abs(norm.Z) < 0.2:
                    caras_verticales.append(face.Area)
            except Exception:
                continue

    if caras_verticales:
        area_util = max(caras_verticales)
    return vol, area_util, None

def procesar_piso(floor, solidos):
    """Calcula volumen y área superior para losas."""
    p_vol = floor.get_Parameter(BuiltInParameter.HOST_VOLUME_COMPUTED)
    vol = p_vol.AsDouble() if (p_vol and p_vol.HasValue) else sum(s.Volume for s in solidos)

    area_sup = 0.0
    for s in solidos:
        for face in s.Faces:
            bb = face.GetBoundingBox()
            u_mid = (bb.Min.U + bb.Max.U) / 2.0
            v_mid = (bb.Min.V + bb.Max.V) / 2.0
            try:
                norm = face.ComputeNormal(UV(u_mid, v_mid))
                if norm.Z > 0.8:
                    area_sup += face.Area
            except Exception:
                continue

    return vol, (area_sup if area_sup > 0.0001 else None), None

# ============================================================
# BUCLE PRINCIPAL
# ============================================================

collector = FilteredElementCollector(doc).WhereElementIsNotElementType().ToElements()

TransactionManager.Instance.EnsureInTransaction(doc)

contador = 0

for el in collector:
    if el.Category is None or el.Category.CategoryType != CategoryType.Model:
        continue

    cat_id = el.Category.Id.IntegerValue
    solidos = obtener_solidos(el)
    
    if not solidos and not hasattr(el, "Location"):
        continue

    v_val, a_val, l_val = None, None, None

    try:
        # 1. MUROS (se procesan SIEMPRE, incluso si tienen Parts)
        if cat_id == int(BuiltInCategory.OST_Walls):
            v_val, a_val, l_val = procesar_muro(el, solidos)

        # 2. VIGAS
        elif cat_id == int(BuiltInCategory.OST_StructuralFraming):
            v_val, a_val, l_val = procesar_viga_exacta(el, solidos)

        # 3. COLUMNAS / PILARES
        elif cat_id in (int(BuiltInCategory.OST_Columns), int(BuiltInCategory.OST_StructuralColumns)):
            v_val, a_val, l_val = procesar_columna(el, solidos)

        # 4. TUBERÍAS
        elif cat_id == int(BuiltInCategory.OST_PipeCurves):
            v_val, a_val, l_val = procesar_tuberia(el, solidos)

        # 5. DUCTOS
        elif cat_id == int(BuiltInCategory.OST_DuctCurves):
            v_val, a_val, l_val = procesar_ducto(el, solidos)

        # 6. PIEZAS (PARTS)
        elif cat_id == int(BuiltInCategory.OST_Parts):
            v_val, a_val, l_val = procesar_part(el, solidos)

        # 7. SUELOS / LOSAS
        elif cat_id == int(BuiltInCategory.OST_Floors):
            v_val, a_val, l_val = procesar_piso(el, solidos)

        # 8. ELEMENTOS GENÉRICOS
        else:
            v_val = sum(s.Volume for s in solidos) if solidos else None

        # Asignación de parámetros
        mapa = {
            "VOLUMEN INTEGRADO": v_val,
            "AREA INTEGRADO": a_val,
            "LONGITUD INTEGRADO": l_val
        }

        tocado = False
        for p_name, val in mapa.items():
            param = el.LookupParameter(p_name)
            if param and not param.IsReadOnly:
                if val is not None and val > 0.00001:
                    param.Set(float(val))
                    tocado = True
                else:
                    try:
                        param.ClearValue()
                    except Exception:
                        param.Set(0.0)
                    tocado = True

        if tocado:
            contador += 1

    except Exception:
        continue

TransactionManager.Instance.TransactionTaskDone()

OUT = f"Ejecución completada con éxito. Elementos actualizados: {contador}"
# ----------------------------------------
watch_3 = Watch(dimensiones_integradas)
nombre_intgerado = Python()  # CPython3; unwired: IN[0]
# ---------- nombre_intgerado.python (53 lines) ----------
import clr

clr.AddReference('RevitAPI')
from Autodesk.Revit.DB import *

clr.AddReference('RevitServices')
import RevitServices
from RevitServices.Persistence import DocumentManager
from RevitServices.Transactions import TransactionManager

doc = DocumentManager.Instance.CurrentDBDocument

# Usamos el collector que te funcionó en el de materiales
collector = FilteredElementCollector(doc).WhereElementIsNotElementType().ToElements()

param_objetivo = "NOMBRE INTEGRADO"
conteo_exito = 0
logs = []

TransactionManager.Instance.EnsureInTransaction(doc)

for e in collector:
    try:
        # 1. Obtener el nombre del tipo (TU_PVCS)
        t_id = e.GetTypeId()
        if t_id == ElementId.InvalidElementId: continue
        
        tipo_elem = doc.GetElement(t_id)
        # Accedemos al BuiltInParameter del nombre para evitar problemas de idioma
        nombre_tipo = tipo_elem.get_Parameter(BuiltInParameter.SYMBOL_NAME_PARAM).AsString()

        # 2. BUSCAR EL PARÁMETRO DE FORMA MANUAL (Más seguro que LookupParameter)
        p_destino = None
        for p in e.Parameters:
            if p.Definition.Name == param_objetivo:
                p_destino = p
                break
        
        # 3. Intentar la escritura
        if p_destino and not p_destino.IsReadOnly:
            p_destino.Set(nombre_tipo)
            conteo_exito += 1
        
    except Exception as ex:
        continue

TransactionManager.Instance.TransactionTaskDone()

# Salida clara
if conteo_exito > 0:
    OUT = "¡ÉXITO! Se actualizaron {} elementos.".format(conteo_exito)
else:
    OUT = "Sigue dando 0. Posible causa: El parámetro 'NOMBRE INTEGRADO' no está asignado a la categoría de los elementos seleccionados."
# ----------------------------------------
watch_4 = Watch(nombre_intgerado)
subproyectos_integrado = Python()  # CPython3; unwired: IN[0]
# ---------- subproyectos_integrado.python (49 lines) ----------
import clr

# Importar la API de Revit
clr.AddReference('RevitAPI')
from Autodesk.Revit.DB import *

# Importar el Gestor de Documentos
clr.AddReference('RevitServices')
import RevitServices
from RevitServices.Persistence import DocumentManager
from RevitServices.Transactions import TransactionManager

# Obtener el documento actual
doc = DocumentManager.Instance.CurrentDBDocument

# 1. Recolectar todos los elementos del modelo (excluyendo tipos)
collector = FilteredElementCollector(doc).WhereElementIsNotElementType()

# 2. Iniciar la transacción para poder escribir datos
TransactionManager.Instance.EnsureInTransaction(doc)

count = 0
errors = 0

for item in collector:
    try:
        # Obtener el ID del subproyecto del elemento
        workset_id = item.WorksetId
        
        # Obtener el nombre del subproyecto desde la tabla de subproyectos
        workset_table = doc.GetWorksetTable()
        workset = workset_table.GetWorkset(workset_id)
        workset_name = workset.Name
        
        # Buscar nuestro parámetro personalizado
        param = item.LookupParameter("SUBPROYECTOS INTEGRADO")
        
        # Si el parámetro existe y no es de solo lectura, escribimos el nombre
        if param and not param.IsReadOnly:
            param.Set(workset_name)
            count += 1
    except:
        errors += 1

# Finalizar la transacción
TransactionManager.Instance.TransactionTaskDone()

# Salida para Dynamo
OUT = "Proceso finalizado. {} elementos actualizados. {} errores.".format(count, errors)
# ----------------------------------------
watch_5 = Watch(subproyectos_integrado)
CLASIFICACIÓN = Python()  # CPython3; unwired: IN[0]
# ---------- CLASIFICACIÓN.python (60 lines) ----------
import clr

# Cargar API de Revit
clr.AddReference('RevitAPI')
from Autodesk.Revit.DB import *

clr.AddReference('RevitServices')
import RevitServices
from RevitServices.Persistence import DocumentManager
from RevitServices.Transactions import TransactionManager

doc = DocumentManager.Instance.CurrentDBDocument
view = doc.ActiveView # Obtiene la vista actual

# --- DICCIONARIO DE MAPEO ---
mapping = {
    "Walls": "MUROS", "Muros": "MUROS",
    "Structural Columns": "COLUMNAS", "Pilares estructurales": "COLUMNAS",
    "Columns": "COLUMNAS", "Pilares": "COLUMNAS",
    "Windows": "VENTANAS", "Ventanas": "VENTANAS",
    "Doors": "PUERTAS", "Puertas": "PUERTAS",
    "Floors": "PISOS / PLACAS", "Suelos": "PISOS / PLACAS",
    "Furniture": "MOBILIARIO", "Mobiliario": "MOBILIARIO",
    "Plumbing Fixtures": "APARATOS SANITARIOS", "Aparatos sanitarios": "APARATOS SANITARIOS",
    "Structural Framing": "VIGAS", "Armazón estructural": "VIGAS",
    "Roofs": "CUBIERTAS", "Cubiertas": "CUBIERTAS",
    "Stairs": "ESCALERAS", "Escaleras": "ESCALERAS"
}

# Colectar TODOS los elementos visibles en la vista activa que tengan categoría
collector = FilteredElementCollector(doc, view.Id)\
            .WhereElementIsNotElementType()\
            .ToElements()

results = []

TransactionManager.Instance.EnsureInTransaction(doc)

for item in collector:
    # Ignorar elementos sin categoría (como líneas de detalle o planos de referencia)
    if item.Category is None:
        continue
        
    try:
        cat_name = item.Category.Name
        # Buscar traducción o usar nombre original en MAYÚSCULAS
        simplified_name = mapping.get(cat_name, cat_name.upper())
        
        # Acceder al parámetro personalizado
        param = item.LookupParameter("CLASIFICACIÓN")
        
        if param and not param.IsReadOnly:
            param.Set(simplified_name)
            results.append("Asignado: " + simplified_name)
    except:
        continue

TransactionManager.Instance.TransactionTaskDone()

OUT = "Se procesaron " + str(len(results)) + " elementos en la vista actual."
# ----------------------------------------
watch_6 = Watch(CLASIFICACIÓN)
